# Grasshopper definition InverseDesign_examples.gh (Grasshopper 1.0.8)
# plug-ins: SpatialGH

activate = Button()
panel = Panel("https://github.com/spatial-lab-systems/spatialgh_inversedesign")

# ----
# Input target program
function = ValueList({"bedroom", "bathroom", "kitchen", "foyer", "living", "extra"}, selected="living")
function_2 = ValueList({"bedroom", "bathroom", "kitchen", "foyer", "living", "extra"}, selected="bathroom")
function_3 = ValueList({"bedroom", "bathroom", "kitchen", "foyer", "living", "extra"}, selected="kitchen")
function_4 = ValueList({"bedroom", "bathroom", "kitchen", "foyer", "living", "extra"}, selected="bedroom")
roominfo = ConstructRoom(Function=function_3, Area=Slider(15, range=0..100))
roominfo_2 = ConstructRoom(Function=function, Area=Slider(30, range=0..100))
roominfo_3 = ConstructRoom(Function=function_2, Area=Slider(10, range=0..100))
roominfo_4 = ConstructRoom(Function=function_4, Area=Slider(30, range=0..100))
merge = Merge(Data1=roominfo, Data2=roominfo_2, Data3=roominfo_4, Data4=roominfo_3)

crv = Curve(<curve referenced from the Rhino model>)

# ----
# Input target boundary
toggle = BooleanToggle(True)
# 1B1B
crv_2 = Curve(<curve referenced from the Rhino model>)
crv_3 = Curve(<curve referenced from the Rhino model>)
apttarget = ConstructTargetApartment(TargetBoundary=crv_2, Circulation=crv, Facade=crv_3, Run=toggle)  # -> TargetApartment, TargetApartmentFlipped

signin = SpatialSignIn(SignIn=activate, SignOut=False, helpersAdded=True)  # -> SignedIn, Activated, Email, Status

# ----
# retreive reference apartment from database
folder_containing_the_database = Panel("E:\Dropbox\Projects\26Summer_Spatial\database")
retreive_count = Panel("5")
searchapt = SearchApartment(
    TargetApartment=apttarget.TargetApartment,
    DatabasePath=folder_containing_the_database,
    N=retreive_count,
    RoomInfo=merge,
    Run=Toggle(True))  # -> Apartments, Info

status = Panel(signin.Status)

# ----
# Input single ref apartment
number_slider = Slider(2, range=0..10)
item = ListItem(List=searchapt.Apartments, Index=number_slider, Wrap=True)

# ----
# inverse design config
# use deaulft params if empty
idconfig = InverseDesignConfig(Iteration=100, CompactWeight=1, AreaWeight=0.1, Resolution=64, LearningRate=0.1, AreaTolerance=0, Tau=0.02)

# ----
# Inverse design (single reference and output)
clear_memory = Button()
invdesign = InverseDesign(
    TargetApartment=apttarget.TargetApartment,
    ReferenceApartment=item,
    RoomInfo=merge,
    Run=Toggle(True),
    ClearMemory=clear_memory,
    Config=idconfig)  # -> Apartment, Loss, Info

detailed_preview = PreviewApartmentDetailed(Apartments=invdesign.Apartment, EnablePreview=Toggle(True), ColorByApartment=False)  # -> Rooms, Walls, Windows, Doors, Entrance, Programs

crv_4 = Curve(<curve referenced from the Rhino model>)

# ----
# Input target boundary
toggle_2 = BooleanToggle(True)
# 2B1B
crv_5 = Curve(<curve referenced from the Rhino model>)
crv_6 = Curve(<curve referenced from the Rhino model>)
apttarget_2 = ConstructTargetApartment(TargetBoundary=crv_5, Circulation=crv_4, Facade=crv_6, Run=toggle_2)  # -> TargetApartment, TargetApartmentFlipped

function_5 = ValueList({"bedroom", "bathroom", "kitchen", "foyer", "living", "extra"}, selected="bedroom")
roominfo_5 = ConstructRoom(Function=function_5, Area=Slider(15, range=0..100))

# ----
# Input target program
function_6 = ValueList({"bedroom", "bathroom", "kitchen", "foyer", "living", "extra"}, selected="kitchen")
function_7 = ValueList({"bedroom", "bathroom", "kitchen", "foyer", "living", "extra"}, selected="bathroom")
function_8 = ValueList({"bedroom", "bathroom", "kitchen", "foyer", "living", "extra"}, selected="bedroom")
function_9 = ValueList({"bedroom", "bathroom", "kitchen", "foyer", "living", "extra"}, selected="living")
roominfo_6 = ConstructRoom(Function=function_6, Area=Slider(15, range=0..100))
roominfo_7 = ConstructRoom(Function=function_9, Area=Slider(30, range=0..100))
roominfo_8 = ConstructRoom(Function=function_8, Area=Slider(20, range=0..100))
roominfo_9 = ConstructRoom(Function=function_7, Area=Slider(10, range=0..100))
merge_2 = Merge(Data1=roominfo_6, Data2=roominfo_7, Data3=roominfo_8, Data4=roominfo_5, Data5=roominfo_9)

# ----
# retreive reference apartment from database
retreive_count_2 = Panel("5")
searchapt_2 = SearchApartment(
    TargetApartment=apttarget_2.TargetApartment,
    DatabasePath=folder_containing_the_database,
    N=retreive_count_2,
    RoomInfo=merge_2,
    Run=Toggle(True))  # -> Apartments, Info

# ----
# Input single ref apartment
number_slider_2 = Slider(0, range=0..10)
item_2 = ListItem(List=searchapt_2.Apartments, Index=number_slider_2, Wrap=True)

# ----
# inverse design config
# use deaulft params if empty
idconfig_2 = InverseDesignConfig(Iteration=100, CompactWeight=1, AreaWeight=0.1, Resolution=64, LearningRate=0.1, AreaTolerance=0, Tau=0.02)

# ----
# Inverse design (single reference and output)
clear_memory_2 = Button()
invdesign_2 = InverseDesign(
    TargetApartment=apttarget_2.TargetApartment,
    ReferenceApartment=item_2,
    RoomInfo=merge_2,
    Run=Toggle(True),
    ClearMemory=clear_memory_2,
    Config=idconfig_2)  # -> Apartment, Loss, Info

detailed_preview_2 = PreviewApartmentDetailed(Apartments=invdesign_2.Apartment, EnablePreview=Toggle(True), ColorByApartment=False)  # -> Rooms, Walls, Windows, Doors, Entrance, Programs

crv_7 = Curve(<curve referenced from the Rhino model>)

# ----
# Input target boundary
toggle_3 = BooleanToggle(True)
# 2B2B
crv_8 = Curve(<curve referenced from the Rhino model>)
crv_9 = Curve(<curve referenced from the Rhino model>)
apttarget_3 = ConstructTargetApartment(TargetBoundary=crv_8, Circulation=crv_7, Facade=crv_9, Run=toggle_3)  # -> TargetApartment, TargetApartmentFlipped

function_10 = ValueList({"bedroom", "bathroom", "kitchen", "foyer", "living", "extra"}, selected="bedroom")
roominfo_10 = ConstructRoom(Function=function_10, Area=Slider(15, range=0..100))

# ----
# Input target program
function_11 = ValueList({"bedroom", "bathroom", "kitchen", "foyer", "living", "extra"}, selected="kitchen")
function_12 = ValueList({"bedroom", "bathroom", "kitchen", "foyer", "living", "extra"}, selected="bathroom")
function_13 = ValueList({"bedroom", "bathroom", "kitchen", "foyer", "living", "extra"}, selected="bathroom")
function_14 = ValueList({"bedroom", "bathroom", "kitchen", "foyer", "living", "extra"}, selected="bedroom")
function_15 = ValueList({"bedroom", "bathroom", "kitchen", "foyer", "living", "extra"}, selected="living")
roominfo_11 = ConstructRoom(Function=function_11, Area=Slider(15, range=0..100))
roominfo_12 = ConstructRoom(Function=function_15, Area=Slider(25, range=0..100))
roominfo_13 = ConstructRoom(Function=function_14, Area=Slider(15, range=0..100))
roominfo_14 = ConstructRoom(Function=function_12, Area=Slider(10, range=0..100))
roominfo_15 = ConstructRoom(Function=function_13, Area=Slider(10, range=0..100))
merge_3 = Merge(Data1=roominfo_11, Data2=roominfo_12, Data3=roominfo_13, Data4=roominfo_10, Data5=roominfo_15, Data6=roominfo_14)

# ----
# retreive reference apartment from database
retreive_count_3 = Panel("5")
searchapt_3 = SearchApartment(
    TargetApartment=apttarget_3.TargetApartment,
    DatabasePath=folder_containing_the_database,
    N=retreive_count_3,
    RoomInfo=merge_3,
    Run=Toggle(True))  # -> Apartments, Info

# ----
# Input single ref apartment
number_slider_3 = Slider(0, range=0..10)
item_3 = ListItem(List=searchapt_3.Apartments, Index=number_slider_3, Wrap=True)

# ----
# inverse design config
# use deaulft params if empty
idconfig_3 = InverseDesignConfig(Iteration=100, CompactWeight=1, AreaWeight=0.1, Resolution=64, LearningRate=0.1, AreaTolerance=0, Tau=0.02)

# ----
# Inverse design (single reference and output)
clear_memory_3 = Button()
invdesign_3 = InverseDesign(
    TargetApartment=apttarget_3.TargetApartment,
    ReferenceApartment=item_3,
    RoomInfo=merge_3,
    Run=Toggle(True),
    ClearMemory=clear_memory_3,
    Config=idconfig_3)  # -> Apartment, Loss, Info

detailed_preview_3 = PreviewApartmentDetailed(Apartments=invdesign_3.Apartment, EnablePreview=Toggle(True), ColorByApartment=False)  # -> Rooms, Walls, Windows, Doors, Entrance, Programs

function_16 = ValueList({"bedroom", "bathroom", "kitchen", "foyer", "living", "extra"}, selected="bedroom")
crv_10 = Curve(<curve referenced from the Rhino model>)

# ----
# Input target boundary
toggle_4 = BooleanToggle(True)
# 3B1B
crv_11 = Curve(<curve referenced from the Rhino model>)
crv_12 = Curve(<curve referenced from the Rhino model>)
apttarget_4 = ConstructTargetApartment(TargetBoundary=crv_11, Circulation=crv_10, Facade=crv_12, Run=toggle_4)  # -> TargetApartment, TargetApartmentFlipped

roominfo_16 = ConstructRoom(Function=function_16, Area=Slider(15, range=0..100))

# ----
# Input target program
function_17 = ValueList({"bedroom", "bathroom", "kitchen", "foyer", "living", "extra"}, selected="kitchen")
function_18 = ValueList({"bedroom", "bathroom", "kitchen", "foyer", "living", "extra"}, selected="bathroom")
function_19 = ValueList({"bedroom", "bathroom", "kitchen", "foyer", "living", "extra"}, selected="bedroom")
function_20 = ValueList({"bedroom", "bathroom", "kitchen", "foyer", "living", "extra"}, selected="bedroom")
function_21 = ValueList({"bedroom", "bathroom", "kitchen", "foyer", "living", "extra"}, selected="living")
roominfo_17 = ConstructRoom(Function=function_17, Area=Slider(15, range=0..100))
roominfo_18 = ConstructRoom(Function=function_21, Area=Slider(25, range=0..100))
roominfo_19 = ConstructRoom(Function=function_20, Area=Slider(15, range=0..100))
roominfo_20 = ConstructRoom(Function=function_18, Area=Slider(10, range=0..100))
roominfo_21 = ConstructRoom(Function=function_19, Area=Slider(10, range=0..100))
merge_4 = Merge(Data1=roominfo_17, Data2=roominfo_18, Data3=roominfo_19, Data4=roominfo_16, Data5=roominfo_21, Data6=roominfo_20)

# ----
# retreive reference apartment from database
retreive_count_4 = Panel("5")
searchapt_4 = SearchApartment(
    TargetApartment=apttarget_4.TargetApartment,
    DatabasePath=folder_containing_the_database,
    N=retreive_count_4,
    RoomInfo=merge_4,
    Run=Toggle(True))  # -> Apartments, Info

# ----
# Input single ref apartment
number_slider_4 = Slider(1, range=0..10)
item_4 = ListItem(List=searchapt_4.Apartments, Index=number_slider_4, Wrap=True)

# ----
# inverse design config
# use deaulft params if empty
idconfig_4 = InverseDesignConfig(Iteration=100, CompactWeight=1, AreaWeight=0.1, Resolution=64, LearningRate=0.1, AreaTolerance=0, Tau=0.02)

# ----
# Inverse design (single reference and output)
clear_memory_4 = Button()
invdesign_4 = InverseDesign(
    TargetApartment=apttarget_4.TargetApartment,
    ReferenceApartment=item_4,
    RoomInfo=merge_4,
    Run=Toggle(True),
    ClearMemory=clear_memory_4,
    Config=idconfig_4)  # -> Apartment, Loss, Info

detailed_preview_4 = PreviewApartmentDetailed(Apartments=invdesign_4.Apartment, EnablePreview=Toggle(True), ColorByApartment=False)  # -> Rooms, Walls, Windows, Doors, Entrance, Programs
