# Grasshopper definition InverseDesign_walkthrough.gh (Grasshopper 1.0.8)
# plug-ins: SpatialGH

activate = Button()
panel = Panel("https://github.com/spatial-lab-systems/spatialgh_inversedesign")

# ----
# Input target program
function = ValueList({"bedroom", "bathroom", "kitchen", "foyer", "living", "extra"}, selected="living")
function_2 = ValueList({"bedroom", "bathroom", "kitchen", "foyer", "living", "extra"}, selected="bathroom")
function_3 = ValueList({"bedroom", "bathroom", "kitchen", "foyer", "living", "extra"}, selected="bedroom")
function_4 = ValueList({"bedroom", "bathroom", "kitchen", "foyer", "living", "extra"}, selected="kitchen")
function_5 = ValueList({"bedroom", "bathroom", "kitchen", "foyer", "living", "extra"}, selected="bedroom")
roominfo = ConstructRoom(Function=function_4, Area=Slider(15, range=0..100))
roominfo_2 = ConstructRoom(Function=function, Area=Slider(30, range=0..100))
roominfo_3 = ConstructRoom(Function=function_2, Area=Slider(10, range=0..100))
roominfo_4 = ConstructRoom(Function=function_5, Area=Slider(20, range=0..100))
roominfo_5 = ConstructRoom(Function=function_3, Area=Slider(15, range=0..100))
merge = Merge(Data1=roominfo, Data2=roominfo_2, Data3=roominfo_4, Data4=roominfo_5, Data5=roominfo_3)
panel_2 = Panel(merge)

# ----
# Input target boundary
toggle = BooleanToggle(True)
circulation = Curve(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)
boundary = Curve(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)
facade = Curve(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)
apttarget = ConstructTargetApartment(TargetBoundary=boundary, Circulation=circulation, Facade=facade, Run=toggle)  # -> TargetApartment, TargetApartmentFlipped

signin = SpatialSignIn(SignIn=activate, SignOut=False, helpersAdded=True)  # -> SignedIn, Activated, Email, Status

# ----
# retreive reference apartment from database
folder_containing_the_database = Panel("E:\Dropbox\Projects\26Summer_Spatial\database")
retreive_count = Panel("5")
searchapt = SearchApartment(
    TargetApartment=apttarget.TargetApartment,
    DatabasePath=folder_containing_the_database,
    N=retreive_count,
    RoomInfo=merge,
    Run=Toggle(True))  # -> Apartments, Info

status = Panel(signin.Status)

# ----
# Inverse design (multi reference and output with filter)
# This contains a prefilter function,
# it removes apartments with low compactness
# after a few iterations
# 
# Inputs a list of reference apartments
toggle_2 = BooleanToggle(True)
invdesignrefs = InverseDesignFromListRef(
    TargetApartment=apttarget.TargetApartment,
    ReferenceApartments=searchapt.Apartments,
    RoomInfo=merge,
    Run=toggle_2,
    PrefilterIter=30,
    PrefilterThreshold=0.9)  # -> Apartments, Loss, Info

# ----
# Input single ref apartment
number_slider = Slider(3, range=0..10)
item = ListItem(List=searchapt.Apartments, Index=number_slider, Wrap=True)

# ----
# room program to add
function_6 = ValueList({"bedroom", "bathroom", "kitchen", "foyer", "living", "extra"}, selected="bathroom")
roominfo_6 = ConstructRoom(Function=function_6, Area=Slider(10, range=0..100))

# ----
# Room to connect and connection type
connection = ValueList({"door", "open"}, selected="door")
pt = Point(Point(-24.37266394, 0.6082735636, 0))

# ----
# inverse design config
# use deaulft params if empty
idconfig = InverseDesignConfig(Iteration=100, CompactWeight=1, AreaWeight=0.1, Resolution=64, LearningRate=0.1, AreaTolerance=0, Tau=0.02)

# ----
# Inverse design (single reference and output)
clear_memory = Button()
invdesign = InverseDesign(
    TargetApartment=apttarget.TargetApartment,
    ReferenceApartment=item,
    RoomInfo=merge,
    Run=Toggle(True),
    ClearMemory=clear_memory,
    Config=idconfig)  # -> Apartment, Loss, Info

# ----
# Room location to remove
pt_2 = Point(Point(-15.02264918, -2.382352343, 0))

# ----
# Remove room from apartment and run inverse design
toggle_3 = BooleanToggle(True)
removeroom = RemoveRoom(Apartment=invdesign.Apartment, Point=pt_2, Run=toggle_3)  # -> Apartment, Loss, Info

# ----
# Rank the reseult apartments.
# can adjust preference between compact and access
toggle_4 = BooleanToggle(True)
postfilter = PostFilter(Apartments=invdesignrefs.Apartments, Run=toggle_4, AccessWeight=1, CompactWeight=0)  # -> Apartments, GED, AccessRate, Info
item_2 = ListItem(List=postfilter.Apartments, Index=Slider(0, range=0..10), Wrap=True)

# ----
# Room location to add
pt_3 = Point(Point(-24.12412923, 4.111587081, 0))

# ----
# Add room to apartment and run inverse design
toggle_5 = BooleanToggle(True)
addroom = AddRoom(Apartment=invdesign.Apartment, RoomInfo=roominfo_6, AddPoint=pt_3, ConnectPoint=pt, Connection=connection, Run=toggle_5)  # -> Apartment, Loss, Info

panel_3 = Panel(removeroom.Info)
panel_4 = Panel(addroom.Info)

# ----
# Connect the result apartment to visualize
toggle_6 = BooleanToggle(True)
detailed_preview = PreviewApartmentDetailed(Apartments=removeroom.Apartment, EnablePreview=toggle_6, ColorByApartment=False)  # -> Rooms, Walls, Windows, Doors, Entrance, Programs
area = Area(Geometry=detailed_preview.Rooms)  # -> Area, Centroid
tag = TextTag3D(
    Location=area.Centroid,
    Text=area.Area,
    Size=Slider(0.3, range=0..1),
    Colour=ColourSwatch(SwatchColor=RGB(255, 255, 255)),
    Justification=5)
