# Grasshopper definition Spatial_basics.gh (Grasshopper 1.0.8)
# plug-ins: SpatialGH

# ----
# New Login via google / berkeley credentials
activate = Button()
panel = Panel("floorplan.spatial-systems.io")
spatial_sign_in = SpatialSignIn(SignIn=activate, SignOut=activate, helpersAdded=True)  # -> SignedIn, Activated, Email, Status
status = Panel(spatial_sign_in.Status)

# ----
# Create Target
boolean_toggle = BooleanToggle(True)
curve = Curve(<curve referenced from the Rhino model>)
curve_2 = Curve(<curve referenced from the Rhino model>)
curve_3 = Curve(<curve referenced from the Rhino model>)
construct_target_apartment = ConstructTargetApartment(TargetBoundary=curve_3, Circulation=curve_2, Facade=curve, Run=boolean_toggle)  # -> TargetApartment, TargetApartmentFlipped

# ----
# Create Hypergraph Apartment from Curves
boolean_toggle_2 = BooleanToggle(True)
guid = Guid([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])
construct_apartment = ConstructApartment(GUIDs=guid, Run=boolean_toggle_2)  # -> Apartment, ID

# ----
# Load Hypergraph Apartment from Database
spatial_cloud_library = SpatialCloudLibrary(Run=False, Count=20, spatial_library_name="New York Residential")  # -> Apartments, Names, Status
apartment = Apartment(spatial_cloud_library.Apartments)

# ----
# Fitting Algorithm
apartment_2 = Apartment(construct_target_apartment.TargetApartment)
apartment_3 = Apartment(construct_apartment.Apartment)
apartment_fit_simple = ApartmentFitSimple(Target=apartment_2, References=apartment_3, ComputeLimit=10, Parallel=False)  # -> Fitted, Count, Tries, ElapsedMs, Info

# ----
# Visualize Reference Floorplan
apartment_4 = Apartment(construct_apartment.Apartment)
ghc_apartmentpreview_hypergraph = GHC_ApartmentPreview_Hypergraph(
    Apartments=apartment_4,
    Preview=True,
    MinDotSize=0.1,
    MaxDotSize=0.25,
    ShowHypergraph=True,
    ShowConnectivity=True,
    ProgramColors=False,
    AdaptiveThickness=False,
    Elevation=0)  # -> GraphEdges, NodeDots, DotSizes, DoorLines, OpenLines
preview_apartment_detailed = PreviewApartmentDetailed(Apartments=apartment_4, EnablePreview=Toggle(True), ColorByApartment=Toggle(False))  # -> Rooms, Walls, Windows, Doors, Entrance, Programs

# ----
# Visualize Fitted Floorplan
number_slider = Slider(4, range=0..100)
list_item = ListItem(List=apartment_fit_simple.Fitted, Index=number_slider, Wrap=True)
ghc_apartmentpreview_hypergraph_2 = GHC_ApartmentPreview_Hypergraph(
    Apartments=list_item,
    Preview=True,
    MinDotSize=0.1,
    MaxDotSize=0.25,
    ShowHypergraph=True,
    ShowConnectivity=True,
    ProgramColors=False,
    AdaptiveThickness=False,
    Elevation=0)  # -> GraphEdges, NodeDots, DotSizes, DoorLines, OpenLines
preview_apartment_detailed_2 = PreviewApartmentDetailed(Apartments=list_item, EnablePreview=Toggle(True), ColorByApartment=Toggle(False))  # -> Rooms, Walls, Windows, Doors, Entrance, Programs

# ----
# Web Editor
liveedit = BooleanToggle(True)
editview = EditView(
    Apartment=list_item,
    NormalizeLocation=True,
    LiveEdit=liveedit,
    editedJson="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",
    liveTogglePlaced=True)  # -> Apartment, JSON, History

# ----
# Fit Furniture
furniture_json = Panel("E:\Dropbox\Projects\26Summer_Spatial\SpatialGH_InverseDesign\database\furniture4.json")
apartment_5 = Apartment(editview.Apartment)
apartment_furniture = ApartmentFurniture(
    Apartment=apartment_5,
    FurniturePath=furniture_json,
    EnablePreview=Toggle(True),
    PreviewSurfaces=True,
    ShowBlocked=True,
    ShowBlocks=True,
    Run=Toggle(True),
    Parallel=Toggle(True),
    OutputGeometry=Toggle(True))  # -> ApartmentOut, LibraryComplete, FurnitureAreas, BlockedAreas, RoomAreas, RoomDrawing, FurnitureDrawing, TotalArea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

curve_4 = Curve(apartment_furniture.FurnitureDrawing)
